# Grasshopper definition junling_test.gh (Grasshopper 1.0.7)

firstnumber = GetInteger(AtLeast=1, AtMost=3, Maximum=2147483647, Minimum=-2147483648, Prompt="FirstNumber", TreeAccess=True)
secondnumber = GetInteger(AtLeast=1, AtMost=1, Maximum=2147483647, Minimum=-2147483648, Prompt="SecondNumber", TreeAccess=False)
mass_addition = MassAddition(Input=firstnumber)  # -> Result, PartialResults
addition = Addition(A=mass_addition.Result, B=secondnumber)
context_print = ContextPrint(OutputNumber=addition)
panel = Panel(addition)
