# Grasshopper definition junling_test_hops.gh (Grasshopper 1.0.7)
# plug-ins: Hops

panel = Panel("""50
3
10
20
30
10""")
file_path = FilePath("C:\Users\13982\OneDrive - Corgan\Documents\Github\aectech-2024-kpf-ttcore-worskhop\src\assets\junling_test.gh")
hops = Hops(
    _Path=file_path,
    FirstNumber=panel,
    SecondNumber=Slider(2, range=0..10),
    CacheResultsInMemory=True,
    CacheSolveResults=True,
    RemoteDefinitionLocation="C:\Users\13982\OneDrive - Corgan\Documents\Github\aectech-2024-kpf-ttcore-worskhop\src\assets\junling_test.gh",
    RemoteSolveVersion=(0, 1, 0),
    ShowInput_Enabled=False,
    ShowInput_Path=True,
    SynchronousSolve=True)
panel_2 = Panel(hops)
