# Grasshopper definition wall_start.gh (Grasshopper 1.0.7)

# ----
# Default hops values/
# useful for testing
height = Slider(17, range=1..20)
width = Slider(33, range=0..40)
number_slider = Slider(1, range=0..2)
dropdown_values = Panel("""Standard
Concave
Convex""")

# ----
# Inputs
shapetype = GetInteger(number_slider, AtLeast=1, AtMost=1, Maximum=2147483647, Minimum=-2147483648, TreeAccess=False)
horizontalrotation = GetInteger(Slider(0, range=0..15), AtLeast=1, AtMost=1, Maximum=2147483647, Minimum=-2147483648, TreeAccess=False)
verticalrotation = GetInteger(Slider(0, range=0..30), AtLeast=1, AtMost=1, Maximum=2147483647, Minimum=-2147483648, TreeAccess=False)
height_2 = GetInteger(height, AtLeast=1, AtMost=1, Maximum=2147483647, Minimum=-2147483648, TreeAccess=False)
width_2 = GetInteger(width, AtLeast=1, AtMost=1, Maximum=2147483647, Minimum=-2147483648, TreeAccess=False)
shapetype_2 = Data(shapetype)
height_3 = Data(height_2)
width_3 = Data(width_2)
verticalrotation_2 = Data(verticalrotation)
horizontalrotation_2 = Data(horizontalrotation)

# ----
# Depending on the logic,
# you can use stream filter or
# just get item by index
list_item = ListItem(List=dropdown_values, Index=number_slider, Wrap=True)

# ---- group: Split geometry into lines
# Wall Example
# Grasshoppper on the Web
# AECtech 2024
# Copyright: 2024 CORE studio | Thornton Tomasetti, Kohn Pedersen Fox Associates PC
# Contact: CORE@ThorntonTomasetti.com, info@kpf.com
# Website: https://www.aectech.us/
panel = Panel("2")
division = Division(A=width_3, B=panel)
negative = Negative(Value=division)
construct_point = ConstructPoint(XCoordinate=negative, YCoordinate=0, ZCoordinate=0)
unit_z = UnitZ(Factor=height_3)
move = Move(Geometry=construct_point, Motion=unit_z)  # -> Geometry, Transform
line = Line(StartPoint=construct_point, EndPoint=move.Geometry)
unit_x = UnitX(Factor="1")
linear_array = LinearArray(Geometry=line, Direction=unit_x, Count=width_3)  # -> Geometry, Transform
dispatch = Dispatch(List=linear_array.Geometry, DispatchPattern=[True, False])  # -> ListA, ListB

# ---- group: Number of bricks in height
multiplication = Multiplication(A=height_3, B="2")
subtraction = Subtraction(A=multiplication, B=Slider(7, range=0..10))

# ---- group: Width/depth brick
number_slider_2 = Slider(0.97, range=0..1)
number_slider_3 = Slider(0.5, range=0..1)
construct_domain = ConstructDomain(DomainStart=number_slider_2, DomainEnd=expr("-x", number_slider_2))
construct_domain_2 = ConstructDomain(DomainStart=number_slider_3, DomainEnd=expr("-x", number_slider_3))

# ----
rowa_curves = Data(dispatch.ListA)
rowb_curves = Data(dispatch.ListB)
width_4 = Data(construct_domain)
depth = Data(construct_domain_2)

# ---- group: Instantiate rectangles
divide_curve = DivideCurve(Curve=rowa_curves, Count=subtraction, Kinks=False)  # -> Points, Tangents, Parameters
dispatch_2 = Dispatch(List=divide_curve.Points, DispatchPattern=[True, False])  # -> ListA, ListB
point = Point(dispatch_2.ListA)
xy_plane = XYPlane(Origin=point)
rectangle = Rectangle(Plane=xy_plane, XSize=width_4, YSize=depth, Radius=0)  # -> Rectangle, Length

divide_curve_2 = DivideCurve(Curve=rowb_curves, Count=subtraction, Kinks=False)  # -> Points, Tangents, Parameters
dispatch_3 = Dispatch(List=divide_curve_2.Points, DispatchPattern=[True, False])  # -> ListA, ListB
point_2 = Point(dispatch_3.ListB)
xy_plane_2 = XYPlane(Origin=point_2)
rectangle_2 = Rectangle(Plane=xy_plane_2, XSize=width_4, YSize=depth, Radius=0)  # -> Rectangle, Length

# ----
dropdown_shape_index = Data(shapetype_2)
dropdown_shape_index_2 = Data(shapetype_2)

# ---- group: Convex/Concave optio
data = Data(rectangle_2.Rectangle)
explode = Explode(Curve=data, Recursive=True)  # -> Segments, Vertices
length = Length(Curve=explode.Segments)
sort_list = SortList(Keys=length, ValuesValuesA=explode.Segments)  # -> Keys, reverse(ValuesValuesA)
list_item_2 = ListItem(List=sort_list.ValuesValuesA, Index=0, Wrap=True)  # -> Item, Item1
evaluate_curve = EvaluateCurve(Curve=reparameterize([list_item_2.Item, list_item_2.Item1]), Parameter=Slider(0.5, range=0..1))  # -> Point, Tangent, Angle
unit_z_2 = UnitZ(Factor=1)
negative_2 = Negative(Value=Slider(0.17, range=0..0.5))
rotate = Rotate(Vector=evaluate_curve.Tangent, Axis=unit_z_2, Angle=degrees(90))
stream_filter = StreamFilter(Gate=dropdown_shape_index_2, Stream0=0, Stream1=Slider(0.17, range=0..0.5), Stream2=negative_2)
amplitude = Amplitude(Vector=rotate, Amplitude=stream_filter)
move_2 = Move(Geometry=evaluate_curve.Point, Motion=amplitude)  # -> Geometry, Transform
list_item_3 = ListItem(List=explode.Vertices, Index=0, Wrap=True)  # -> Item, Item1, Item2, Item3
list_item_4 = ListItem(List=move_2.Geometry, Index=0, Wrap=True)  # -> Item, Item1
data_2 = Data(list_item_4.Item)
data_3 = Data(list_item_4.Item1)
data_4 = Data(list_item_3.Item)
data_5 = Data(list_item_3.Item1)
data_6 = Data(list_item_3.Item2)
data_7 = Data(list_item_3.Item3)
merge = Merge(Data1=data_4, Data2=data_3, Data3=data_5, Data4=data_6, Data5=data_2, Data6=data_7)
polyline = PolyLine(Vertices=merge, Closed=True)
trim_tree = TrimTree(Tree=polyline, Depth=1)
stream_filter_2 = StreamFilter(Gate=dropdown_shape_index_2, Stream0=data, Stream1=trim_tree, Stream2=trim_tree)

# ----
dropdown_shape_index_3 = Data(dropdown_shape_index)

# ---- group: Convex/Concave option
data_8 = Data(rectangle.Rectangle)
explode_2 = Explode(Curve=data_8, Recursive=True)  # -> Segments, Vertices
length_2 = Length(Curve=explode_2.Segments)
sort_list_2 = SortList(Keys=length_2, ValuesValuesA=explode_2.Segments)  # -> Keys, reverse(ValuesValuesA)
list_item_5 = ListItem(List=sort_list_2.ValuesValuesA, Index=0, Wrap=True)  # -> Item, Item1
evaluate_curve_2 = EvaluateCurve(Curve=reparameterize([list_item_5.Item, list_item_5.Item1]), Parameter=Slider(0.5, range=0..1))  # -> Point, Tangent, Angle
negative_3 = Negative(Value=Slider(0.17, range=0..0.5))
unit_z_3 = UnitZ(Factor=1)
stream_filter_3 = StreamFilter(Gate=dropdown_shape_index_3, Stream0=0, Stream1=Slider(0.17, range=0..0.5), Stream2=negative_3)
rotate_2 = Rotate(Vector=evaluate_curve_2.Tangent, Axis=unit_z_3, Angle=degrees(90))
amplitude_2 = Amplitude(Vector=rotate_2, Amplitude=stream_filter_3)
move_3 = Move(Geometry=evaluate_curve_2.Point, Motion=amplitude_2)  # -> Geometry, Transform
list_item_6 = ListItem(List=explode_2.Vertices, Index=0, Wrap=True)  # -> Item, Item1, Item2, Item3
list_item_7 = ListItem(List=move_3.Geometry, Index=0, Wrap=True)  # -> Item, Item1
data_9 = Data(list_item_6.Item)
data_10 = Data(list_item_6.Item1)
data_11 = Data(list_item_6.Item2)
data_12 = Data(list_item_6.Item3)
data_13 = Data(list_item_7.Item)
data_14 = Data(list_item_7.Item1)
merge_2 = Merge(Data1=data_9, Data2=data_14, Data3=data_10, Data4=data_11, Data5=data_13, Data6=data_12)
polyline_2 = PolyLine(Vertices=merge_2, Closed=True)
trim_tree_2 = TrimTree(Tree=polyline_2, Depth=1)
stream_filter_4 = StreamFilter(Gate=dropdown_shape_index_3, Stream0=rectangle.Rectangle, Stream1=trim_tree_2, Stream2=trim_tree_2)

# ---- group: Height
unit_z_4 = UnitZ(Factor=Slider(0.6, range=0..1))

# ----
vertical_rotation = Data(verticalrotation_2)
horizontal_rotation = Data(horizontalrotation_2)

# ---- group: Extrude
surface = Surface(stream_filter_4)
extrude = Extrude(Base=surface, Direction=unit_z_4)
volume = Volume(Geometry=extrude)  # -> Volume, Centroid
explode_tree = ExplodeTree(Data=extrude)  # -> Branch0, Branch1
list_length = ListLength(List=rowa_curves)
list_length_2 = ListLength(List=explode_tree.Branch0)
series = Series(Start=0, Step=vertical_rotation, Count=list_length)
xy_plane_3 = XYPlane(Origin=volume.Centroid)
series_2 = Series(Start=series, Step=horizontal_rotation, Count=list_length_2)
rotate_3 = Rotate(Geometry=extrude, Angle=degrees(series_2), Plane=xy_plane_3)  # -> Geometry, Transform

surface_2 = Surface(stream_filter_2)
extrude_2 = Extrude(Base=surface_2, Direction=unit_z_4)
list_length_3 = ListLength(List=rowb_curves)
explode_tree_2 = ExplodeTree(Data=extrude_2)  # -> Branch0, Branch1
volume_2 = Volume(Geometry=extrude_2)  # -> Volume, Centroid
series_3 = Series(Start=0, Step=vertical_rotation, Count=list_length_3)
list_length_4 = ListLength(List=explode_tree_2.Branch0)
xy_plane_4 = XYPlane(Origin=volume_2.Centroid)
series_4 = Series(Start=series_3, Step=horizontal_rotation, Count=list_length_4)
rotate_4 = Rotate(Geometry=extrude_2, Angle=degrees(series_4), Plane=xy_plane_4)  # -> Geometry, Transform

# ----
merge_3 = Merge(Data1=rotate_3.Geometry, Data2=rotate_4.Geometry)  # -> flatten(Result)
custom_preview = CustomPreview(Geometry=merge_3, Material=ColourSwatch(SwatchColor=RGBA(209, 61, 61, 206)))
list_length_5 = ListLength(List=merge_3)
concatenate = Concatenate(Fragment_A="You generated ", Fragment_B=list_length_5, A=" beautiful bricks!")
mesh = Mesh(merge_3)
# Outputs
context_bake = ContextBake(Geometry=mesh)
context_print = ContextPrint(Text=concatenate)
panel_2 = Panel(concatenate)
