# Grasshopper definition wall_start_hops.gh (Grasshopper 1.0.7)
# plug-ins: Hops

file_path = FilePath("C:\Users\13982\OneDrive - Corgan\Documents\Github\aectech-2024-kpf-ttcore-worskhop\src\assets\wall_start.gh")
hops = Hops(
    _Path=file_path,
    Height=Slider(6, range=0..20),
    Width=Slider(20, range=0..40),
    VerticalRotation=Slider(27, range=0..30),
    HorizontalRotation=Slider(9, range=0..15),
    ShapeType=Slider(1, range=0..2),
    CacheResultsInMemory=True,
    CacheSolveResults=True,
    RemoteDefinitionLocation="C:\Users\13982\OneDrive - Corgan\Documents\Github\aectech-2024-kpf-ttcore-worskhop\src\assets\wall_start.gh",
    RemoteSolveVersion=(0, 1, 0),
    ShowInput_Enabled=False,
    ShowInput_Path=True,
    SynchronousSolve=True)  # -> Geometry, Text
panel = Panel(hops.Text)
panel_2 = Panel(hops.Geometry)
